# Grasshopper definition clock.gh (Grasshopper 1.0.7)

time = ConstructTime(Hour=Slider(6, range=0..24), Minute=Slider(21, range=0..60), Second=Slider(15, range=0..60))
c_script = CSharpScript()  # -> out, H, M, S, C, AngleHour, AngleMinute
# ---------- c_script: C# ----------
    if (time == DateTime.MinValue)
    {

      time = DateTime.Now;
      DateTime localDate = DateTime.Now;
    }

    {
      int Hour = time.Hour;
      int Minute = time.Minute;
      int Second = time.Second;


      var pt = new Point3d(0, 0, 0);
      var ptH = new Point3d(0, 15, 0);
      var ptM = new Point3d(0, 20, 0);
      var ptS = new Point3d(0, 27, 0);

      C = new Circle(pt, 30);

      var lineH = new Line(pt, ptH);
      var lineM = new Line(pt, ptM);


      lineH.Transform(Transform.Rotation(((360 / 12) * Hour) * Math.PI / 180, pt));
      lineM.Transform(Transform.Rotation(((360 / 60) * Minute) * Math.PI / 180, pt));
      ptS.Transform(Transform.Rotation(((360 / 60) * Second) * Math.PI / 180, pt));

      S = new Circle(ptS, 2);
      H = lineH;
      M = lineM;
      AngleHour = CalculateHourAngle(Hour, Minute);
      AngleMinute = CalculateMinuteAngle(Minute);

    }
# ---------- c_script: C# additional code ----------
  double CalculateHourAngle (int Hour, int Minute)
  {
    double angleHour = ((360 / 12 * Hour) + (1 / 2 * Minute) * Math.PI / 180);
    return angleHour;
  }

  double CalculateMinuteAngle (int Minute)
  {
    double angleMinute = ((360 / 60 * Minute) * Math.PI / 180);
    return angleMinute;
  }
# ---------- end c_script ----------
timer = Timer(TimerInterval=1000, Target=c_script)
panel = Panel(c_script.out)
crv = Curve(c_script.M)
crv_2 = Curve(c_script.C)
crv_3 = Curve(c_script.H)
crv_4 = Curve(c_script.S)
panel_2 = Panel(c_script.AngleMinute)
panel_3 = Panel(c_script.AngleHour)
