# Grasshopper definition Clock.gh (Grasshopper 1.0.7)

number_slider = Slider(0, range=0..9000)
# Я использую входной тип даты/времени, поэтому
# при передаче нулевых значений также покажется время системы.
# 
# Через строки не захотел.
# Эвенты подключения компонентов не понял
number_slider_2 = Slider(1, range=0..24)

time = ConstructTime(Hour=number_slider_2, Minute=Slider(0, range=0..1000), Second=Slider(0, range=0..360))
c_script = CSharpScript()  # -> out, clockBody, hourArrow, minuteArrow, secondArrow
# ---------- c_script: C# ----------
    // установка времени
    int H;
    int M;
    int S;

    if (time.ToString() == "01/01/0001 00:00:00")
    {
      H = DateTime.Now.Hour;
      M = DateTime.Now.Minute;
      S = DateTime.Now.Second;
    }
    else
    {
      H = time.Hour;
      M = time.Minute;
      S = time.Second;
    }



    // часы
    var centrePt = new Point3d(0, 0, 0);
    var dial = new Circle(centrePt, 20);



    // секундная стрелка
    var secondPt = new Point3d(0, 18.5, 0);

    var secondDegAngle = 6 * S;
    var secondRadAngle = secondDegAngle * -Math.PI / 180;
    secondPt.Transform(Transform.Rotation(secondRadAngle, centrePt));

    var secondCircle = new Circle(secondPt, 0.5);




    // минутная стрелка
    var minutePt = new Point3d(0, 16.5, 0);

    var minutePureDegAngle = 6 * M;
    var minuteDegAngle = minutePureDegAngle + secondDegAngle / 60;
    var minuteRadAngle = minuteDegAngle * -Math.PI / 180;
    minutePt.Transform(Transform.Rotation(minuteRadAngle, centrePt));

    var minuteLine = new Line(centrePt, minutePt);



    // часовая стрелка
    var hourPt = new Point3d(0, 12, 0);

    var hourPureDegAngle = 30 * H;
    var hourDegAngle = hourPureDegAngle + minuteDegAngle / 12;
    var hourRadAngle = hourDegAngle * -Math.PI / 180;
    hourPt.Transform(Transform.Rotation(hourRadAngle, centrePt));

    var hourLine = new Line(centrePt, hourPt);



    // выходные параметры
    clockBody = dial;
    hourArrow = hourLine;
    minuteArrow = minuteLine;
    secondArrow = secondCircle;
# ---------- end c_script ----------
timer = Timer(TimerInterval=1000, Target=c_script)  # disabled
panel = Panel(c_script.out)

crv = Curve(c_script.clockBody)
crv_2 = Curve(c_script.hourArrow)
crv_3 = Curve(c_script.minuteArrow)
crv_4 = Curve(c_script.secondArrow)
