# Grasshopper definition time.gh (Grasshopper 1.0.7)

time = ConstructTime(Hour=Slider(2, range=0..100), Minute=Slider(61, range=0..100), Second=Slider(59, range=0..100))
txt = Text(time)
c_script = CSharpScript(time=txt)  # -> out, A, B, H, M, S, C; inputs time: String
# ---------- c_script: C# ----------
    string [] parts;
    if(time == null)
    time = DateTime.Now.ToLongTimeString();
    
    parts = time.Split(':');
    var hour = parts[0];
    var minute = parts[1];
    var min = int.Parse(minute);
    var hr = int.Parse(hour);
    var sec = parts[2];
    var pt = new Point3d(0, 0, 0);
    var ptS = new Point3d(0, 4000, 0);
    var ptM = new Point3d(0, 3000, 0);
    var ptH = new Point3d(0, 2000, 0);
    ptS.Transform(Transform.Rotation(((360 / 60) * (Int32.Parse(sec)) * -3.14 / 180), pt));
    S = new Circle(ptS, 100);
    var lineMin = new Line(pt, ptM);
    lineMin.Transform(Transform.Rotation(((360 / 60) * min * -3.14 / 180), pt));
    C = new Circle(pt, 5000);
    var lineHour = new Line(pt, ptH);
    lineHour.Transform(Transform.Rotation(CalculateHourAngle(hr, min), pt));
    H = lineHour;
    M = lineMin;
    A = CalculateHourAngle(hr, min);
    // B = hAngle;
    // CalculateHourAngle(int hour, int minute);
# ---------- c_script: C# additional code ----------
  double CalculateHourAngle (int h, int m)
  {
    var hAngle = (((360 / 12) * h) + (0.5 * m)) * -3.14 / 180;
    return hAngle;
  }
  // double CalculateMinuteAngle (int minute)
  //  {

  //  }
# ---------- end c_script ----------
data = Data(c_script.M)
data_2 = Data(c_script.S)
data_3 = Data(c_script.H)
panel = Panel(c_script.B)
