# Grasshopper definition test 01.gh (Grasshopper 1.0.7)
# plug-ins: Robot, TestPlugin

# ---- group: combinations
F = File("E:\Repos\ROBOT_BI\Modules\Apt_combinations\combinations_9.txt")

# ---- group: hblock type
F_2 = File(["E:\Repos\ROBOT_BI\Modules\Apt_hblocks\M9.txt", "E:\Repos\ROBOT_BI\Modules\Apt_hblocks\M16.txt"])

# ---- group: all flats
F_3 = File(["E:\Repos\ROBOT_BI\FlatsOBD\1.5S_type1_46.48_b_L_D.json", "E:\Repos\ROBOT_BI\FlatsOBD\1.5S_type1_46.48_b_L_U.json", "E:\Repos\ROBOT_BI\FlatsOBD\1.5S_type1_46.48_b_R_D.json", "E:\Repos\ROBOT_BI\FlatsOBD\1.5S_type1_46.48_b_R_U.json", "E:\Repos\ROBOT_BI\FlatsOBD\1.5S_type2_48.40_b_L_D.json", "E:\Repos\ROBOT_BI\FlatsOBD\1.5S_type2_48.40_b_L_U.json"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])

# ----
file = ReadFile(File=F_3, PerLineParse=False)
file_2 = ReadFile(File=F, PerLineParse=False)
file_3 = ReadFile(File=F_2, PerLineParse=True)
panel = Panel(file)
readflat = ReadFlat(JSON=file)  # -> flatten(Flat)
deflat = DeconstructFlat(Flat=readflat)  # -> ID, Contour, Windows, Door, Plane, Rooms, GrossArea, Top, Bottom
number_slider = Slider(1000, range=0..1000)
c_script = CSharpScript(x=readflat, Reference="E:\Repos\c-sharp-tasks\08_TestPlugin\TestPlugin\References\Robot.dll")  # -> out, A; disabled
# ---------- c_script: C# usings ----------
using Robot;
# ---------- c_script: C# ----------
    var flat = x as Robot.Flat;
    A = flat.Code;
# ---------- end c_script ----------
tmatch = MatchText(Text=deflat.ID, Pattern=graft(file_3), Case=True)
panel_2 = Panel(c_script.A)
cull = CullPattern(List=readflat, CullPattern=tmatch)
Y = UnitY(Factor=Slider(2321, range=0..10000))
item = ListItem(Index=0, Wrap=True)
pshift = ShiftPaths(Data=cull, Offset=-1)
nickname = TestPlugin(Flats=pshift, Combinations=file_2)
number_slider_2 = Slider(1500, range=0..10000)
deflat_2 = DeconstructFlat(Flat=pshift)  # -> ID, Contour, Windows, Door, Plane, Rooms, GrossArea, Top, Bottom
item_2 = ListItem(List=nickname, Index=0, Wrap=True)
boundary = BoundarySurfaces(Edges=deflat_2.Contour)
panel_3 = Panel(nickname)
X = UnitX(Factor=Slider(37100, range=0..100000))
delevel = DeconstructLevel(Level=nickname)  # -> ID, FloorNo, Flats, LLU, Contour, MOP, Walls, AptType
deflat_3 = DeconstructFlat(Flat=delevel.Flats)  # -> ID, Contour, Windows, Door, Plane, Rooms, GrossArea, Top, Bottom
bbox = BoundingBox(Content=deflat_3.Contour, Plane=PlaneXY(0, 0, 0))  # -> Box, Box_2
box_corners = BoxCorners(Box=bbox.Box)  # -> graft(CornerA), graft(CornerB), graft(CornerC), graft(CornerD), CornerE, CornerF, CornerG, CornerH
avr = Average(Input=[box_corners.CornerA, box_corners.CornerB])
avr_2 = Average(Input=[box_corners.CornerA, box_corners.CornerB, box_corners.CornerC, box_corners.CornerD])
avr_3 = Average(Input=[box_corners.CornerC, box_corners.CornerD])
move = Move(Geometry=avr_3, Motion=Y)  # -> Geometry, Transform
tag = TextTag3D(Location=avr, Text=graft(deflat_3.Bottom), Size=number_slider_2, Justification=7)  # disabled
tag_2 = TextTag3D(Location=avr_3, Text=graft(deflat_3.Top), Size=number_slider_2, Justification=7)  # disabled
tag_3 = TextTag(Location=avr_3)  # disabled
tag_4 = TextTag3D(Location=avr_2, Text=graft(deflat_3.ID), Size=Slider(500, range=0..1000), Justification=5)  # disabled
tag_5 = TextTag3D(Location=avr_2, Text=graft(panel_2), Size=number_slider_2, Justification=5)  # disabled
move_2 = Move(Geometry=item_2, Motion=X)  # -> Geometry, Transform
join = TextJoin(Text=delevel.AptType)  # -> flatten(Result)
item_3 = ListItem(List=delevel.Flats, Index=Slider(3, range=0..10), Wrap=True)
c_script_2 = CSharpScript(length=F, size=F_2)  # -> out, graft(A); inputs length: String, size: String
# ---------- c_script_2: C# usings ----------
using System.IO;
using System.Linq;
# ---------- c_script_2: C# ----------
    var steps = Path.GetFileNameWithoutExtension(length).Split('_').Last();
    Print(steps);
    
    var sizeTxt = Path.GetFileNameWithoutExtension(size);
    var height = System.Text.RegularExpressions.Regex.Match(sizeTxt, @"\d+").Value;
    Print(height);
    var hblockType = System.Text.RegularExpressions.Regex.Match(sizeTxt, @"\D+").Value;
    Print(hblockType);
    
    string llu, storeys;
    switch (height)
    {
      case "9":
        llu = "S";
        storeys = "2-9";
        break;
      case "16":
        llu = "M";
        storeys = "2-16";
        break;
      case "24":
        llu = "L";
        storeys = "2-24";
        break;
      default:
        llu = "WTF";
        storeys = "WTF";
        break;
    }
    
    A = string.Format("Lvl_{0}_{1}_{2}_{3}.json", hblockType, llu, steps, storeys);
# ---------- end c_script_2 ----------
crjson = CreateJson(Object=nickname)
deflat_4 = DeconstructFlat(Flat=delevel.Flats)  # -> ID, Contour, Windows, Door, Plane, Rooms, GrossArea, Top, Bottom
cset = CreateSet(List=flatten(join))  # -> Set, Map
join_2 = TextJoin(Text=deflat_4.ID)
panel_4 = Panel(deflat_4.Top)
crv = Curve(deflat_4.Contour)
panel_5 = Panel(delevel.AptType)
panel_6 = Panel(c_script_2.A)
cset_2 = CreateSet(List=flatten(join_2))  # -> Set, Map
panel_7 = Panel(join_2)
savetxt = SaveTextFile(save=Button(), str=crjson, path="E:\Repos\ROBOT_BI\LevelsOBD", fileName=panel_6)  # -> out, A; inputs save: Boolean, str: String, path: String, fileName: String
# ---------- savetxt: C# ----------
    string fullPath = path + @"/" + fileName;
    if(save) System.IO.File.WriteAllText(fullPath, str);
# ---------- end savetxt ----------
